# Grasshopper definition TestConnections.ghx (Grasshopper 1.0.7)
# plug-ins: HAL for Grasshopper

sessionsettings = SessionSettings()
python = GhPythonScript(on=Button())  # -> out
# ---------- python: Python ----------
"""
On boolean true input, load the reach map data
    Args:
        on: BOOL
        preview: Display points
    Returns:
        data: The loaded data.
        X : X data
        Y : Y data
        Z : Z data
        R : Reach data
"""
        
ghenv.Component.Message = 'LoadArm v0.1'
        
import rhinoscriptsyntax as rs
import time
        
if on:
    from compas.rpc import Proxy
        
    # pythonw prevents a window from opening
    with Proxy('vs068_pb.utils', python='C:\Users\Sam\Anaconda3\envs\project\python.exe') as proxy:
        botId, cid = proxy.quick_load_bot(1)
        proxy.loadFloor(cid)
        time.sleep(10)
# ---------- end python ----------
python_2 = GhPythonScript(on=Button(), preview=Toggle(False))  # -> out, a
# ---------- python_2: Python ----------
"""
On boolean true input, load the reach map data
    Args:
        on: BOOL
        preview: Display points
    Returns:
        data: The loaded data.
        X : X data
        Y : Y data
        Z : Z data
        R : Reach data
"""
        
ghenv.Component.Message = 'TestReach v0.1'
        
import scriptcontext as sc
import rhinoscriptsyntax as rs
import Rhino as r
import Rhino.Geometry as rg
import System.Drawing as sd
        
data = sc.sticky.get("data", None)
display = sc.sticky.get("display", r.Display.CustomDisplay(True))
        
if on:
    from compas.rpc import Proxy
        
    # pythonw prevents a window from opening
    with Proxy('vs068_pb.ghpython', python='C:\Users\Sam\Anaconda3\envs\project\pythonw.exe') as proxy:
        data = proxy.load_reach_data()
        sc.sticky["data"] = data
                
def column(A, i):
    return [row[int(i)] for row in A]
        
X = column(data, 0)
Y = column(data, 1)
Z = column(data, 2)
R = column(data, 3)
        
#pnts = [[rs.AddPoint([X[i], Y[i], Z[i]])] for i in range(len(X))]
#pnts = []
#for i in range(len(X)):
# pnts.append(rs.AddPoint([X[int(i)], Y[int(i)], Z[int(i)]]))
            
reach = R
        
if preview == True and preview != None:

    for i in range(len(X)):
        x = X[i]
        y = Y[i]
        z = Z[i]
        c = R[i]
                
        r_c = max(0,int(255*(0.5-c)/0.5))
        g_c = max(0,int(255*(c-0.5)/0.5))
        b_c = int(255*abs(0.5-abs(0.5-c))/0.5)*c
            
        color = sd.Color.FromArgb(r_c, g_c, b_c)
        Pt = rg.Point3d(100*x,100*y,100*z)
        display.AddPoint(Pt, color, r.Display.PointStyle.X, 2)
        sc.sticky["display"] = display
else:
    display.Clear()
    display.Dispose()
    del sc.sticky["display"]
# ---------- end python_2 ----------
python_3 = GhPythonScript(on=Button())  # -> out, pose
# ---------- python_3: Python ----------
"""
On boolean true input, load the reach map data
    Args:
        on: BOOL
        preview: Display points
    Returns:
        data: The loaded data.
        X : X data
        Y : Y data
        Z : Z data
        R : Reach data
"""
        
ghenv.Component.Message = 'LoadDemo v0.1'
        
import rhinoscriptsyntax as rs
import time
import scriptcontext as sc

pose = sc.sticky.get("pose", [0,0,0])
        
        
        

if on:
    from compas.rpc import Proxy
        
    # pythonw prevents a window from opening
    with Proxy('vs068_pb.ghpython', python='C:\Users\Sam\Anaconda3\envs\project\python.exe') as proxy:
        pose = proxy.load_demo()
        sc.sticky["pose"] = pose
# ---------- end python_3 ----------
python_4 = GhPythonScript(on=Button())  # -> out, a
# ---------- python_4: Python ----------
__author__ = "Sam"
__version__ = "2021.05.12"

import rhinoscriptsyntax as rs
import scriptcontext as sc
import Grasshopper
from Grasshopper.Kernel import GH_Param, GH_Convert, Parameters

ghenv.Component.Message = 'ClearPose v0.1'

def ghSolutionRecompute():
    """ Recomputes the Grasshopper solution (ala pressing F5) """
    
    def expireAllComponentsButThis(e):
        for obj in ghenv.Component.OnPingDocument().Objects:
            if not obj.InstanceGuid == ghenv.Component.InstanceGuid:
                obj.ExpireSolution(False)
                
    ghenv.Component.OnPingDocument().ScheduleSolution(1000,expireAllComponentsButThis)



if on:
    sc.sticky["pose"] = [0,0,0]
    ghSolutionRecompute()
# ---------- end python_4 ----------
panel = Panel(python_3.pose)
